test file "TurnLights_TestSuite"

suite "New Test Suite 1"

  case "New Test Case 1" [baseline]
    test data file: TurnLights_TestCases.xlsx
    model TurnLights_Model, harness TurnLights_Model_Harness (for TurnLights_Model/TurnLights_Algorithm)
    input "1" from TurnLights_TestCases.xlsx, mapped to TurnLights_InputAcquistions
    input "2" from TurnLights_TestCases.xlsx, mapped to TurnLights_InputAcquistions
    input "3" from TurnLights_TestCases.xlsx, mapped to TurnLights_InputAcquistions
    input "4" from TurnLights_TestCases.xlsx, mapped to TurnLights_InputAcquistions
    input "5" from TurnLights_TestCases.xlsx, mapped to TurnLights_InputAcquistions
    input "6" from TurnLights_TestCases.xlsx, mapped to TurnLights_InputAcquistions
    input "7" from TurnLights_TestCases.xlsx, mapped to TurnLights_InputAcquistions
    input "8" from TurnLights_TestCases.xlsx, mapped to TurnLights_InputAcquistions
    baseline "1"
      LH_Front_TL
      LH_Rear_TL
      RH_Front_TL
      RH_Rear_TL
    baseline "2"
      LH_Front_TL
      LH_Rear_TL
      RH_Front_TL
      RH_Rear_TL
    baseline "3"
      LH_Front_TL
      LH_Rear_TL
      RH_Front_TL
      RH_Rear_TL
    baseline "4"
      LH_Front_TL
      LH_Rear_TL
      RH_Front_TL
      RH_Rear_TL
    baseline "5"
      LH_Front_TL
      LH_Rear_TL
      RH_Front_TL
      RH_Rear_TL
    baseline "6"
      LH_Front_TL
      LH_Rear_TL
      RH_Front_TL
      RH_Rear_TL
    baseline "7"
      LH_Front_TL
      LH_Rear_TL
      RH_Front_TL
      RH_Rear_TL
    baseline "8"
      LH_Front_TL
      LH_Rear_TL
      RH_Front_TL
      RH_Rear_TL
    iterations:
      1: ExternalInput "1", Baseline "1"
      2: ExternalInput "2", Baseline "2"
      3: ExternalInput "3", Baseline "3"
      4: ExternalInput "4", Baseline "4"
      5: ExternalInput "5", Baseline "5"
      6: ExternalInput "6", Baseline "6"
      7: ExternalInput "7", Baseline "7"
      8: ExternalInput "8", Baseline "8"