test file "TurnLights_TestSuite"

suite "New Test Suite 1"

  case "New Test Case 1" [baseline]
    test data file: TurnLights_TestProcedure.xlsx
    model TurnLights_Model, harness TurnLights_Model_Harness_SIL (for TurnLights_Model/TurnLights_Algorithm)
    input "Scenario1" from TurnLights_TestProcedure.xlsx, mapped to TurnLights_InputAcquistions
    input "Scenario2" from TurnLights_TestProcedure.xlsx, mapped to TurnLights_InputAcquistions
    input "Scenario3" from TurnLights_TestProcedure.xlsx, mapped to TurnLights_InputAcquistions
    input "Scenario4" from TurnLights_TestProcedure.xlsx, mapped to TurnLights_InputAcquistions
    input "Scenario5" from TurnLights_TestProcedure.xlsx, mapped to TurnLights_InputAcquistions
    input "Scenario6" from TurnLights_TestProcedure.xlsx, mapped to TurnLights_InputAcquistions
    input "Scenario7" from TurnLights_TestProcedure.xlsx, mapped to TurnLights_InputAcquistions
    input "Scenario8" from TurnLights_TestProcedure.xlsx, mapped to TurnLights_InputAcquistions
    baseline "Scenario1"
      LH_Front_TL
      LH_Rear_TL
      RH_Front_TL
      RH_Rear_TL
    baseline "Scenario2"
      LH_Front_TL
      LH_Rear_TL
      RH_Front_TL
      RH_Rear_TL
    baseline "Scenario3"
      LH_Front_TL
      LH_Rear_TL
      RH_Front_TL
      RH_Rear_TL
    baseline "Scenario4"
      LH_Front_TL
      LH_Rear_TL
      RH_Front_TL
      RH_Rear_TL
    baseline "Scenario5"
      LH_Front_TL
      LH_Rear_TL
      RH_Front_TL
      RH_Rear_TL
    baseline "Scenario6"
      LH_Front_TL
      LH_Rear_TL
      RH_Front_TL
      RH_Rear_TL
    baseline "Scenario7"
      LH_Front_TL
      LH_Rear_TL
      RH_Front_TL
      RH_Rear_TL
    baseline "Scenario8"
      LH_Front_TL
      LH_Rear_TL
      RH_Front_TL
      RH_Rear_TL
    iterations:
      Scenario1: ExternalInput "Scenario1", Baseline "Scenario1"
      Scenario2: ExternalInput "Scenario2", Baseline "Scenario2"
      Scenario3: ExternalInput "Scenario3", Baseline "Scenario3"
      Scenario4: ExternalInput "Scenario4", Baseline "Scenario4"
      Scenario5: ExternalInput "Scenario5", Baseline "Scenario5"
      Scenario6: ExternalInput "Scenario6", Baseline "Scenario6"
      Scenario7: ExternalInput "Scenario7", Baseline "Scenario7"
      Scenario8: ExternalInput "Scenario8", Baseline "Scenario8"